# Dynamo graph Link_COM_Acad_SAMPLE_Layouts.dyn (Dynamo 2.17.3.4871)

# group: Getting document
acadApplicationVersions = DynNCXLib.AcadApplication.AcadApplicationVersions()
acadApplication = DynNCXLib.AcadApplication.AcadApplication(progID=acadApplicationVersions.nanoCAD_23)
activeDocument = DynNCXLib.AcadApplication.ActiveDocument(acadApplication=acadApplication)
acadDatabase = DynNCXLib.AcadDatabase.AcadDatabase(AcadDocument=activeDocument)

# group: Getting layouts and all objects on each layout
layouts = DynNCXLib.AcadDatabase.Layouts(acadDatabase=acadDatabase)
getLayouts = DynNCXLib.AcadLayouts.GetLayouts(acadLayouts=layouts)
block = DynNCXLib.AcadLayout.Block(acadLayout=getLayouts)
name = DynNCXLib.AcadBlock.Name(acadBlock=block)
getObjects = DynNCXLib.AcadBlock.GetObjects(acadBlock=block)
entityName = DynNCXLib.AcadEntity.EntityName(acadEntity=getObjects)

# group: Getting linled PlotConfigurations for each Layout
acadPlotConfiguration = DynNCXLib.AcadPlotConfiguration.AcadPlotConfiguration(AcadLayout=getLayouts)
name_2 = DynNCXLib.AcadPlotConfiguration.Name(acadPlotConfiguration=acadPlotConfiguration)
