# Dynamo graph Link_COM_Ncad_SAMPLE_CreatePrimitiveObjects.dyn (Dynamo 2.17.3.4871)

getCOMProcesses = DynNCXLib.AcadApplication.GetCOMProcesses()
code_block = CodeBlock { "nanoCADx64.Application.23.0"; }

# group: Get Document instance
acadApplicationVersions = DynNCXLib.AcadApplication.AcadApplicationVersions()
acadApplication = DynNCXLib.AcadApplication.AcadApplication(progID=acadApplicationVersions.nanoCAD_24_0)
activeDocument = DynNCXLib.AcadApplication.ActiveDocument(acadApplication=acadApplication)
acadDatabase = DynNCXLib.AcadDatabase.AcadDatabase(AcadDocument=activeDocument)

modelSpace = DynNCXLib.AcadDatabase.ModelSpace(acadDatabase=acadDatabase)

# group: Create 3D-face with 3 and 3 vertices
coordinates_for_face_of_3_point = CodeBlock()
# ---------- coordinates_for_face_of_3_point.designscript (3 lines) ----------
DynNCXLib.GeometryWrapper.Point.ByCoordinates(0,0,0);
DynNCXLib.GeometryWrapper.Point.ByCoordinates(3,0,0);
DynNCXLib.GeometryWrapper.Point.ByCoordinates(0,3,0);
# ----------------------------------------
acad3DFace = DynNCXLib.Acad3DFace.Acad3DFace(AcadBlock=modelSpace, Point1=coordinates_for_face_of_3_point.out0, Point2=coordinates_for_face_of_3_point.out1, Point3=coordinates_for_face_of_3_point.out2, Point4=coordinates_for_face_of_3_point.out2)
coordinates_for_face_of_4_point = CodeBlock()
# ---------- coordinates_for_face_of_4_point.designscript (4 lines) ----------
DynNCXLib.GeometryWrapper.Point.ByCoordinates(0,0,0);
DynNCXLib.GeometryWrapper.Point.ByCoordinates(2,0,0);
DynNCXLib.GeometryWrapper.Point.ByCoordinates(2,2,0);
DynNCXLib.GeometryWrapper.Point.ByCoordinates(0,2,0);
# ----------------------------------------
acad3DFace_2 = DynNCXLib.Acad3DFace.Acad3DFace(AcadBlock=modelSpace, Point1=coordinates_for_face_of_4_point.out0, Point2=coordinates_for_face_of_4_point.out1, Point3=coordinates_for_face_of_4_point.out2, Point4=coordinates_for_face_of_4_point.out3)

# group: Create Arc
code_block_2 = CodeBlock { [DynNCXLib.GeometryWrapper.Point.ByCoordinates(2,2,0)]; 1; 0; }
acadArc = DynNCXLib.AcadArc.AcadArc(AcadBlock=modelSpace, Center=code_block_2.out0, Radius=code_block_2.out1, StartAngle=code_block_2.out2, EndAngle=code_block_2.out1)

# group: Get Blocks
blocks = DynNCXLib.AcadDatabase.Blocks(acadDatabase=acadDatabase)
getObjects = DynNCXLib.AcadBlocks.GetObjects(acadBlocks=blocks)
name = DynNCXLib.AcadBlock.Name(acadBlock=getObjects)
code_block_3 = CodeBlock { "*"; }
contains = String.Contains(string=name, searchFor=code_block_3)
filterByBoolMask = List.FilterByBoolMask(list=name, mask=contains)

# group: Create BlockReference
blockref_creation = CodeBlock(bl=filterByBoolMask.out) { bl[0]; [DynNCXLib.GeometryWrapper.Point.ByCoordinates(2,4,0)]; 1.0; 0.0; }
acadBlockReference = DynNCXLib.AcadBlockReference.AcadBlockReference(AcadBlock=modelSpace, InsertionPoint=blockref_creation.out1, Name=blockref_creation.out0, Xscale=blockref_creation.out2, Yscale=blockref_creation.out2, Zscale=blockref_creation.out2, Rotation=blockref_creation.out3)

# group: Create Circle
blockref_creation_2 = CodeBlock { [DynNCXLib.GeometryWrapper.Point.ByCoordinates(6,6,0)]; 2.0; }
acadCircle = DynNCXLib.AcadCircle.AcadCircle(AcadBlock=modelSpace, Center=blockref_creation_2.out0, Radius=blockref_creation_2.out1)

# group: Create Ellipse
code_block_4 = CodeBlock { DynNCXLib.GeometryWrapper.Point.ByCoordinates(6,9, 0); DynNCXLib.GeometryWrapper.Point.ByCoordinates(6,11, 0); 0.6; }
acadEllipse = DynNCXLib.AcadEllipse.AcadEllipse(AcadBlock=modelSpace, Center=code_block_4.out0, MajorAxis=code_block_4.out1, RadiusRatio=code_block_4.out2)

# group: Create Hatch definition
acHatchPatternTypePreDefined = OdaX.AcPatternType.acHatchPatternTypePreDefined()
code_block_5 = CodeBlock { "SOLID"; true; }
acGradientObject = OdaX.AcHatchObjectType.acGradientObject()
acadHatch = DynNCXLib.AcadHatch.AcadHatch(AcadBlock=modelSpace, PatternType=acHatchPatternTypePreDefined, PatternName=code_block_5.out0, Associativity=code_block_5.out1, HatchObjectType=acGradientObject)

# group: Create Polyline (getting only x\y from source coordinates)
code_block_6 = CodeBlock()
# ---------- code_block_6.designscript (6 lines) ----------
[DynNCXLib.GeometryWrapper.Point.ByCoordinates(7,0),
DynNCXLib.GeometryWrapper.Point.ByCoordinates(7,2),
DynNCXLib.GeometryWrapper.Point.ByCoordinates(6,3,0),
DynNCXLib.GeometryWrapper.Point.ByCoordinates(6,-1)];
DynNCXLib.GeometryWrapper.Point.ByCoordinates(6,-3);
4;
# ----------------------------------------
acadLWPolyline = DynNCXLib.AcadLWPolyline.AcadLWPolyline(AcadBlock=modelSpace, VerticesList=code_block_6.out0)
addVertex = DynNCXLib.AcadLWPolyline.AddVertex(acadLWPolyline=acadLWPolyline, Index=code_block_6.out2, vertex=code_block_6.out1)

# group: Specify pline closed
code_block_7 = CodeBlock(wait_void=addVertex, p=acadLWPolyline) { wait_void; p; true; }
set_Closed = DynNCXLib.AcadLWPolyline.Set_Closed(acadLWPolyline=code_block_7.p, fClose=code_block_7.out2)
code_block_8 = CodeBlock(wait_void=set_Closed, pline=acadLWPolyline) { wait_void; pline; }

# group: Append to Hatch outer contour. Source countour MUST be closed (as exception 'Invalid input')
byAnyObject = DynNCXLib.AcadEntity.ByAnyObject(AnyModelObject=code_block_8.pline)
code_block_9 = CodeBlock(a=byAnyObject) { a; b = [a]; }
appendOuterLoop = DynNCXLib.AcadHatch.AppendOuterLoop(acadHatch=acadHatch, ObjectArray=code_block_9.b)

# group: Create Leader with two variants: with and without Annotation object
code_block_10 = CodeBlock()
# ---------- code_block_10.designscript (4 lines) ----------
[DynNCXLib.GeometryWrapper.Point.ByCoordinates(9,4, 0),
DynNCXLib.GeometryWrapper.Point.ByCoordinates(12,8, 0),
DynNCXLib.GeometryWrapper.Point.ByCoordinates(12,9, 0)];
0;
# ----------------------------------------
acLineWithArrow = OdaX.AcLeaderType.acLineWithArrow()
acadLeader = DynNCXLib.AcadLeader.AcadLeader(AcadBlock=modelSpace, PointsArray=code_block_10.out0, Type=acLineWithArrow)  # frozen; unwired: Annotation
code_block_11 = CodeBlock()
# ---------- code_block_11.designscript (4 lines) ----------
[DynNCXLib.GeometryWrapper.Point.ByCoordinates(10,4, 0),
DynNCXLib.GeometryWrapper.Point.ByCoordinates(13,8, 0),
DynNCXLib.GeometryWrapper.Point.ByCoordinates(13,9, 0)];
0;
# ----------------------------------------
acadLeader_2 = DynNCXLib.AcadLeader.AcadLeader(AcadBlock=modelSpace, PointsArray=code_block_11.out0, Type=acLineWithArrow)

# group: Create Text and MText objects
code_block_12 = CodeBlock()
# ---------- code_block_12.designscript (8 lines) ----------
"Hello, Text!";

10;
DynNCXLib.GeometryWrapper.Point.ByCoordinates(15,2,0);
DynNCXLib.GeometryWrapper.Point.ByCoordinates(15,5,0);
0.1;
"Hello,
MText!";
# ----------------------------------------
acadText = DynNCXLib.AcadText.AcadText(AcadBlock=modelSpace, TextString=code_block_12.out0, InsertionPoint=code_block_12.out2, Height=code_block_12.out4)
acadMText = DynNCXLib.AcadMText.AcadMText(AcadBlock=modelSpace, InsertionPoint=code_block_12.out3, Width=code_block_12.out1, Text=code_block_12.out5)

# group: Create Spline (from list of 3d points)
code_block_13 = CodeBlock()
# ---------- code_block_13.designscript (6 lines) ----------
[DynNCXLib.GeometryWrapper.Point.ByCoordinates(22,1,0),
DynNCXLib.GeometryWrapper.Point.ByCoordinates(23,3,0),
DynNCXLib.GeometryWrapper.Point.ByCoordinates(22,4,0),
DynNCXLib.GeometryWrapper.Point.ByCoordinates(23,8,0)];
DynNCXLib.GeometryWrapper.Vector.ByCoordinates(22,1,1);
DynNCXLib.GeometryWrapper.Vector.ByCoordinates(23,10,0);
# ----------------------------------------
acadSpline = DynNCXLib.AcadSpline.AcadSpline(AcadBlock=modelSpace, PointsArray=code_block_13.out0, StartTangent=code_block_13.out1, EndTangent=code_block_13.out2)

# group: Create new Solid (non Solid3d)
code_block_14 = CodeBlock()
# ---------- code_block_14.designscript (4 lines) ----------
DynNCXLib.GeometryWrapper.Point.ByCoordinates(22,12,0);
DynNCXLib.GeometryWrapper.Point.ByCoordinates(21,14,2);
DynNCXLib.GeometryWrapper.Point.ByCoordinates(23,10,0);
DynNCXLib.GeometryWrapper.Point.ByCoordinates(22,11,3);
# ----------------------------------------
acadSolid = DynNCXLib.AcadSolid.AcadSolid(AcadBlock=modelSpace, Point1=code_block_14.out0, Point2=code_block_14.out1, Point3=code_block_14.out2, Point4=code_block_14.out3)

# group: Create Ray
code_block_15 = CodeBlock()
# ---------- code_block_15.designscript (5 lines) ----------
DynNCXLib.GeometryWrapper.Point.ByCoordinates(24,2,0);
DynNCXLib.GeometryWrapper.Point.ByCoordinates(24,4,0);
2.0;
15;
"Shape 1";
# ----------------------------------------
acadRay = DynNCXLib.AcadRay.AcadRay(AcadBlock=modelSpace, Point1=code_block_15.out0, Point2=code_block_15.out1)

# group: Create point and set variable PDMODE = 34
code_block_16 = CodeBlock { DynNCXLib.GeometryWrapper.Point.ByCoordinates(24,8,0); }
acadPoint = DynNCXLib.AcadPoint.AcadPoint(AcadBlock=modelSpace, Point=code_block_16)
code_block_17 = CodeBlock { "PDMODE 34  "; }
sendCommand = DynNCXLib.AcadDocument.SendCommand(acadDocument=activeDocument, command=code_block_17)

# group: Create MLeader (the couple of points must multiple 3)
code_block_18 = CodeBlock()
# ---------- code_block_18.designscript (6 lines) ----------
[DynNCXLib.GeometryWrapper.Point.ByCoordinates(25,4, 0),
DynNCXLib.GeometryWrapper.Point.ByCoordinates(24,8, 0),
DynNCXLib.GeometryWrapper.Point.ByCoordinates(24,9, 0),
DynNCXLib.GeometryWrapper.Point.ByCoordinates(25,10, 0),
DynNCXLib.GeometryWrapper.Point.ByCoordinates(25,12, 0),
DynNCXLib.GeometryWrapper.Point.ByCoordinates(25,9, 0)];
# ----------------------------------------
acadMLeader = DynNCXLib.AcadMLeader.AcadMLeader(AcadBlock=modelSpace, PointsArray=code_block_18)

# group: Create Line
code_block_19 = CodeBlock { DynNCXLib.GeometryWrapper.Point.ByCoordinates(28, 0, 0); DynNCXLib.GeometryWrapper.Point.ByCoordinates(27,10,10); }
acadLine = DynNCXLib.AcadLine.AcadLine(AcadBlock=modelSpace, StartPoint=code_block_19.out0, EndPoint=code_block_19.out1)

# group: Create 2x2 PolygonMesh from 3x3 point's grid
code_block_20 = CodeBlock()
# ---------- code_block_20.designscript (10 lines) ----------
[DynNCXLib.GeometryWrapper.Point.ByCoordinates(30,0,1),
DynNCXLib.GeometryWrapper.Point.ByCoordinates(31,0,2),
DynNCXLib.GeometryWrapper.Point.ByCoordinates(32,0,-2),
DynNCXLib.GeometryWrapper.Point.ByCoordinates(30,1,5),
DynNCXLib.GeometryWrapper.Point.ByCoordinates(31,1,3),
DynNCXLib.GeometryWrapper.Point.ByCoordinates(32,1,2),
DynNCXLib.GeometryWrapper.Point.ByCoordinates(30,2,4),
DynNCXLib.GeometryWrapper.Point.ByCoordinates(31,2,0),
DynNCXLib.GeometryWrapper.Point.ByCoordinates(32,2,1)];
3;
# ----------------------------------------
acadPolygonMesh = DynNCXLib.AcadPolygonMesh.AcadPolygonMesh(AcadBlock=modelSpace, M=code_block_20.out1, N=code_block_20.out1, PointsMatrix=code_block_20.out0)
