# Dynamo graph Link_COM_Ncad_SAMPLE_CreateSolids3d.dyn (Dynamo 2.17.3.4871)

# group: Get document
acadApplicationVersions = DynNCXLib.AcadApplication.AcadApplicationVersions()
acadApplication = DynNCXLib.AcadApplication.AcadApplication(progID=acadApplicationVersions.nanoCAD_24_0)
activeDocument = DynNCXLib.AcadApplication.ActiveDocument(acadApplication=acadApplication)
fullName = DynNCXLib.AcadDocument.FullName(acadDocument=activeDocument)
acadDatabase = DynNCXLib.AcadDatabase.AcadDatabase(AcadDocument=activeDocument)

modelSpace = DynNCXLib.AcadDatabase.ModelSpace(acadDatabase=acadDatabase)

# group: Elliptical Cone
code_block = CodeBlock { DynNCXLib.GeometryWrapper.Point.ByCoordinates(0,0,0); 3; 1; 5; }
addEllipticalCone = DynNCXLib.Acad3DSolid.AddEllipticalCone(AcadBlock=modelSpace, Center=code_block.out0, MajorRadius=code_block.out1, MinorRadius=code_block.out2, Height=code_block.out3)

# group: Elliptical cylinder
code_block_2 = CodeBlock { DynNCXLib.GeometryWrapper.Point.ByCoordinates(10,0,0); 3; 1; 5; }
addEllipticalCylinder = DynNCXLib.Acad3DSolid.AddEllipticalCylinder(AcadBlock=modelSpace, Center=code_block_2.out0, MajorRadius=code_block_2.out3, MinorRadius=code_block_2.out1, Height=code_block_2.out2)

# group: Create extruded solid
code_block_3 = CodeBlock { DynNCXLib.GeometryWrapper.Point.ByCoordinates(20,0,0); 3; 2; 0.22231; }
acadCircle = DynNCXLib.AcadCircle.AcadCircle(AcadBlock=modelSpace, Center=code_block_3.out0, Radius=code_block_3.out1)
list_create = List.Create(item0=acadCircle)
acadRegion = DynNCXLib.AcadRegion.AcadRegion(AcadBlock=modelSpace, ObjectList=list_create)
addExtrudedSolid = DynNCXLib.Acad3DSolid.AddExtrudedSolid(AcadBlock=modelSpace, Profile=acadRegion, Height=code_block_3.out2, TaperAngle=code_block_3.out3)

# group: Create ExtrudedSolidAlongPath (with Spline)
code_block_4 = CodeBlock()
# ---------- code_block_4.designscript (5 lines) ----------
[DynNCXLib.GeometryWrapper.Point.ByCoordinates(30,0,0),
DynNCXLib.GeometryWrapper.Point.ByCoordinates(27,5,10),
DynNCXLib.GeometryWrapper.Point.ByCoordinates(28,7,10)];
DynNCXLib.GeometryWrapper.Vector.ByCoordinates(1,0,0);
DynNCXLib.GeometryWrapper.Vector.ByCoordinates(1,20,0);
# ----------------------------------------
acadSpline = DynNCXLib.AcadSpline.AcadSpline(AcadBlock=modelSpace, PointsArray=code_block_4.out0, StartTangent=code_block_4.out1, EndTangent=code_block_4.out2)
addExtrudedSolidAlongPath = DynNCXLib.Acad3DSolid.AddExtrudedSolidAlongPath(AcadBlock=modelSpace, Profile=acadRegion, Path=acadSpline)

# group: Create RevolvedSolid
code_block_5 = CodeBlock()
# ---------- code_block_5.designscript (4 lines) ----------
DynNCXLib.GeometryWrapper.Point.ByCoordinates(40,0,0);
DynNCXLib.GeometryWrapper.Vector.ByCoordinates(40,10,0);
DynNCXLib.GeometryWrapper.Vector.ByCoordinates(1,20,0);
5;
# ----------------------------------------
addRevolvedSolid = DynNCXLib.Acad3DSolid.AddRevolvedSolid(AcadBlock=modelSpace, Profile=acadRegion, AxisPoint=code_block_5.out0, AxisDir=code_block_5.out1, Angle=code_block_5.out3)

# group: Create solid as union two solids
acUnion = OdaX.AcBooleanType.acUnion()
boolean = DynNCXLib.Acad3DSolid.Boolean(acad3DSolid=addExtrudedSolidAlongPath, BooleanType=acUnion, SolidOrRegionObject=addRevolvedSolid)

# group: Create Box
code_block_6 = CodeBlock { DynNCXLib.GeometryWrapper.Point.ByCoordinates(0,50,0); 6; 4; 1; }
createBox = DynNCXLib.Acad3DSolid.CreateBox(AcadBlock=modelSpace, Origin=code_block_6.out0, Length=code_block_6.out1, Width=code_block_6.out2, Height=code_block_6.out3)

# group: Create Cone
code_block_7 = CodeBlock { DynNCXLib.GeometryWrapper.Point.ByCoordinates(10,50,0); 3; 5; }
createCone = DynNCXLib.Acad3DSolid.CreateCone(AcadBlock=modelSpace, Center=code_block_7.out0, BaseRadius=code_block_7.out1, Height=code_block_7.out2)

# group: Create Cylinder
code_block_8 = CodeBlock { DynNCXLib.GeometryWrapper.Point.ByCoordinates(20,50,0); 3; 4; }
createCylinder = DynNCXLib.Acad3DSolid.CreateCylinder(AcadBlock=modelSpace, Center=code_block_8.out0, Radius=code_block_8.out2, Height=code_block_8.out1)

# group: Create Sphere
code_block_9 = CodeBlock { DynNCXLib.GeometryWrapper.Point.ByCoordinates(30,50,0); 3; }
createSphere = DynNCXLib.Acad3DSolid.CreateSphere(AcadBlock=modelSpace, Center=code_block_9.out0, Radius=code_block_9.out1)

# group: Create Torus
code_block_10 = CodeBlock { DynNCXLib.GeometryWrapper.Point.ByCoordinates(40,50); 3; 1; }
createTorus = DynNCXLib.Acad3DSolid.CreateTorus(AcadBlock=modelSpace, Center=code_block_10.out0, TorusRadius=code_block_10.out1, TubeRadius=code_block_10.out2)

# group: Create Wedge
code_block_11 = CodeBlock { DynNCXLib.GeometryWrapper.Point.ByCoordinates(50,50,0); 5; 4; 2; }
createWedge = DynNCXLib.Acad3DSolid.CreateWedge(AcadBlock=modelSpace, Center=code_block_11.out0, Length=code_block_11.out1, Width=code_block_11.out2, Height=code_block_11.out3)
