# Dynamo graph Link_COM_Ncad_SAMPLE_DocumentData.dyn "Link_COM_Acad_SAMPLE_DocumentData" (Dynamo 2.17.3.4871)

acadApplicationVersions = DynNCXLib.AcadApplication.AcadApplicationVersions()
acadApplication = DynNCXLib.AcadApplication.AcadApplication(progID=acadApplicationVersions.nanoCAD_23)
activeDocument = DynNCXLib.AcadApplication.ActiveDocument(acadApplication=acadApplication)
acadDatabase = DynNCXLib.AcadDatabase.AcadDatabase(AcadDocument=activeDocument)

# group: Working With Summary Info
summaryInfo = DynNCXLib.AcadDatabase.SummaryInfo(acadDatabase=acadDatabase)
code_block = CodeBlock { "Some property"; "Some value"; }
addCustomInfo = DynNCXLib.AcadSummaryInfo.AddCustomInfo(acadSummaryInfo=summaryInfo, key=code_block.out0, Value=code_block.out1)

# group: Getting UCS info
userCoordinateSystems = DynNCXLib.AcadDatabase.UserCoordinateSystems(acadDatabase=acadDatabase)
getAcadUCS = DynNCXLib.AcadUCSs.GetAcadUCS(acadUCSs=userCoordinateSystems)
name = DynNCXLib.AcadUCS.Name(acadUCS=getAcadUCS)
origin = DynNCXLib.AcadUCS.Origin(acadUCS=getAcadUCS)

# group: Getting Plot's info
plotConfigurations = DynNCXLib.AcadDatabase.PlotConfigurations(acadDatabase=acadDatabase)
getAcadPlotConfigurations = DynNCXLib.AcadPlotConfigurations.GetAcadPlotConfigurations(acadPlotConfigurations=plotConfigurations)
configName = DynNCXLib.AcadPlotConfiguration.ConfigName(acadPlotConfiguration=getAcadPlotConfigurations)
name_2 = DynNCXLib.AcadPlotConfiguration.Name(acadPlotConfiguration=getAcadPlotConfigurations)

# group: Getting limits info
limits = DynNCXLib.AcadDatabase.Limits(acadDatabase=acadDatabase)
