# Dynamo graph Link_COM_Ncad_SAMPLE_MeshWorking.dyn (Dynamo 2.17.3.4871)

# group: Get document
acadApplicationVersions = DynNCXLib.AcadApplication.AcadApplicationVersions()
acadApplication = DynNCXLib.AcadApplication.AcadApplication(progID=acadApplicationVersions.nanoCAD_22)
activeDocument = DynNCXLib.AcadApplication.ActiveDocument(acadApplication=acadApplication)
fullName = DynNCXLib.AcadDocument.FullName(acadDocument=activeDocument)
acadDatabase = DynNCXLib.AcadDatabase.AcadDatabase(AcadDocument=activeDocument)

modelSpace = DynNCXLib.AcadDatabase.ModelSpace(acadDatabase=acadDatabase)
getObjects = DynNCXLib.AcadBlock.GetObjects(acadBlock=modelSpace)  # frozen
entityName = DynNCXLib.AcadEntity.EntityName(acadEntity=getObjects)

# group: Get object - Solid3d
code_block = CodeBlock { ["AcDb3dSolid"]; }
getEntitiesByEntityNames = DynNCXLib.AcadEntity.GetEntitiesByEntityNames(AcadBlock=modelSpace, EntityNames=code_block)

# group: get Solid3d info
acad3DSolid = DynNCXLib.Acad3DSolid.Acad3DSolid(AcadEntity=getEntitiesByEntityNames)
volume = DynNCXLib.Acad3DSolid.Volume(acad3DSolid=acad3DSolid)
centroid = DynNCXLib.Acad3DSolid.Centroid(acad3DSolid=acad3DSolid)
coordinates = DynNCXLib.GeometryWrapper.Point.Coordinates(point=centroid)

# group: Get object - Polyface mesh
code_block_2 = CodeBlock { ["AcDbPolyFaceMesh"]; }
getEntitiesByEntityNames_2 = DynNCXLib.AcadEntity.GetEntitiesByEntityNames(AcadBlock=modelSpace, EntityNames=code_block_2)

# group: Get PolyFace mesh geometry as points
acadPolyfaceMesh = DynNCXLib.AcadPolyfaceMesh.AcadPolyfaceMesh(AcadEntity=getEntitiesByEntityNames_2)
coordinates_2 = DynNCXLib.AcadPolyfaceMesh.Coordinates(acadPolyfaceMesh=acadPolyfaceMesh)
coordinates_3 = DynNCXLib.GeometryWrapper.Point.Coordinates(point=coordinates_2)
