# Dynamo graph Link_COM_Ncad_SAMPLE_ModelStudio_Objects.dyn (Dynamo 2.17.3.4871)

# group: Get document
acadApplicationVersions = DynNCXLib.AcadApplication.AcadApplicationVersions()
acadApplication = DynNCXLib.AcadApplication.AcadApplication(progID=acadApplicationVersions.nanoCAD_22)
activeDocument = DynNCXLib.AcadApplication.ActiveDocument(acadApplication=acadApplication)
fullName = DynNCXLib.AcadDocument.FullName(acadDocument=activeDocument)
acadDatabase = DynNCXLib.AcadDatabase.AcadDatabase(AcadDocument=activeDocument)

modelSpace = DynNCXLib.AcadDatabase.ModelSpace(acadDatabase=acadDatabase)

# group: Get ModelStudio object by class's name
getObjects = DynNCXLib.AcadBlock.GetObjects(acadBlock=modelSpace)
entityName = DynNCXLib.AcadEntity.EntityName(acadEntity=getObjects)
code_block = CodeBlock { "CAECLinearWall"; }
eq = entityName == code_block
filterByBoolMask = List.FilterByBoolMask(list=getObjects, mask=eq)

# group: Getting parameters from MS Element
fromEntiy = DynmdsUnitsLib.Element.FromEntiy(AcadEntity=filterByBoolMask.in)
parameters = DynmdsUnitsLib.Element.Parameters(element=fromEntiy)
getParameters = DynmdsUnitsLib.Parameters.GetParameters(parameters=parameters)
name = DynmdsUnitsLib.Parameter.Name(parameter=getParameters)
value = DynmdsUnitsLib.Parameter.Value(parameter=getParameters)

# group: Get ModelStudio object by class's name (ANALOGUE)
code_block_2 = CodeBlock { ["CAECLinearWall"]; }
getEntitiesByEntityNames = DynNCXLib.AcadEntity.GetEntitiesByEntityNames(AcadBlock=modelSpace, EntityNames=code_block_2)
