# Dynamo graph Edit_polyline_coordinates.dyn (Dynamo 2.13.1.3887)
# packages: Link_COM_Acad 0.1.4, Link_COM_Acad 0.1.8

code_block = CodeBlock { Point.ByCoordinates(1600, -700); 2; }
connectToAcadDoc = Custom[ConnectToAcadDoc]()  # package Link_COM_Acad; Getting an AcadDocument instance from current Civil 3D Dynamo document (node Document.Current)
acadDatabase = DynAXDBLib.AcadDatabase.AcadDatabase(AcadDocument=connectToAcadDoc)
select_object = ObjectSelection()  # 1 picked in the model
code_block_2 = CodeBlock(o=select_object) { o.Handle; }
string_from_object = FromObject(object=code_block_2)
handleToObject = DynAXDBLib.AcadDatabase.HandleToObject(acadDatabase=acadDatabase, Handle=string_from_object)
acadMLeader = DynAXDBLib.AcadMLeader.AcadMLeader(AcadEntity=handleToObject)
